# Grasshopper definition Connect.gh (Grasshopper 1.0.7)

topopt_python = GhPythonScript(
    L=Slider(192, range=100..450),
    t=Slider(10, range=5..40),
    Lc=Slider(20, range=5..60),
    Pu=Slider(120, range=0..10000),
    Mu=Slider(120, range=0..10000),
    Vu=Slider(120, range=0..10000),
    ec_max=Slider(0.2, range=0..1.5))  # -> out
# ---------- topopt_python: Python ----------
__author__ = "pitipatw"
__version__ = "2023.03.10"

import rhinoscriptsyntax as rs
import ghpythonlib.treehelpers as th
import json

# assign static values
output = dict() 
output["L"] = L
output["t"] = t
output["Lc"] = Lc
output["Pu"] = Pu
output["Mu"] = Mu
output["Vu"] = Vu
output["ec_max"] = ec_max
print(json.dumps(output))
# ---------- end topopt_python ----------
server_port = Panel("ws://127.0.0.1:2000/")
websocket_client_start = WebsocketClientStart(Address=server_port, InitalMessage=topopt_python, Reset=Button())
websocket_client_receiver = WebsocketClientReceiver(WebsocketObjects=websocket_client_start, AutoUpdate=True)  # -> Message, Status
panel = Panel(topopt_python)
python = GhPythonScript(input=websocket_client_receiver.Message)  # -> out, fc_prime, area_steel, fpe, ec; inputs points: tree
# ---------- python: Python ----------
__author__ = "pitipatw"
__version__ = "2023.01.24"

import rhinoscriptsyntax as rs
import ghpythonlib.treehelpers as th
import json



data = json.loads(input)
n = len(data)
#turn each list into smaller list
fc_prime   = [None] * n
area_steel = [None] * n
ec         = [None] * n
fpe        = [None] * n
for i in range(n):
    fc_prime[i]   = data[i]["fc_prime"]
    area_steel[i] = data[i]["as"]
    ec[i]         = data[i]["ec"]
    fpe[i]        = data[i]["fpe"]
# ---------- end python ----------
graft = GraftTree(Tree=python.fc_prime, IncludeEmptyLists=True, IncludeNullItems=True)
graft_2 = GraftTree(Tree=python.area_steel, IncludeEmptyLists=True, IncludeNullItems=True)
graft_3 = GraftTree(Tree=python.fpe, IncludeEmptyLists=True, IncludeNullItems=True)
graft_4 = GraftTree(Tree=python.ec, IncludeEmptyLists=True, IncludeNullItems=True)
merge = Merge(Data1=graft, Data2=graft_2, Data3=graft_3, Data4=graft_4)
panel_2 = Panel(merge)
